# Dynamo graph FloorFromFloor.dyn (Dynamo 2.3.0.5885)
# packages: Hypar 0.0.1

categories = Categories("OST_StructuralColumns")
all_elements_of_category = ElementsOfCategory(Category=categories)
convertRevitColumn = HyparDynamo.Hypar.Column.ConvertRevitColumn(column=all_elements_of_category)
categories_2 = Categories("OST_Walls")
all_elements_of_category_2 = ElementsOfCategory(Category=categories_2)
fromRevitWall = HyparDynamo.Hypar.Wall.FromRevitWall(incomingWall=all_elements_of_category_2)
file_path = Filename(".\RevitToDynamoToHypar.glb")
categories_3 = Categories("OST_Floors")
all_elements_of_category_3 = ElementsOfCategory(Category=categories_3)
fromRevitFloor = HyparDynamo.Hypar.Floor.FromRevitFloor(incomingFloor=all_elements_of_category_3)
flatten = List.Flatten(list=fromRevitFloor)
modelFromElements = HyparDynamo.Hypar.Model.ModelFromElements(elements=flatten)
writeGlb = HyparDynamo.Hypar.Model.WriteGlb(filePath=file_path, model=modelFromElements)
code_block = CodeBlock {  }
